# Grasshopper definition Export Without Baking.gh (Grasshopper 1.0.7)

panel = Panel("Version=5 SaveSmall=No GeometryOnly=No SaveTextures=No SaveNotes=No SavePlugInData=No")
polygon = Polygon(Plane=PlaneXY(0, 0, 0), Radius=3, Segments=5, FilletRadius=0)  # -> Polygon, Length
cir = Circle(Plane=PlaneXY(0, 0, 0), Radius=4)
rectangle = Rectangle(Plane=PlaneXY(0, 0, 0), XSize=Domain(-2, 2), YSize=Domain(-2, 2), Radius=0.25)  # -> Rectangle, Length
srf = Surface(cir)
box = Box({Plane=PlaneXY(0, 0, 0), X=Domain(0, 18), Y=Domain(0, 18), Z=Domain(0, 18)})
srf_2 = Surface(rectangle.Rectangle)
srf_3 = Surface(polygon.Polygon)
arrbox = BoxArray(Geometry=srf, Cell=box, XCount=4, YCount=4, ZCount=1)  # -> Geometry, Transform
arrbox_2 = BoxArray(Geometry=srf_2, Cell=box, XCount=4, YCount=4, ZCount=1)  # -> Geometry, Transform
arrbox_3 = BoxArray(Geometry=srf_3, Cell=box, XCount=4, YCount=4, ZCount=1)  # -> Geometry, Transform
move = Move(Geometry=arrbox_2.Geometry, Motion=Vector(6, -6, 0))  # -> Geometry, Transform
move_2 = Move(Geometry=arrbox_3.Geometry, Motion=Vector(-6, 6, 0))  # -> Geometry, Transform
entwine = Entwine(Branch00=arrbox.Geometry, Branch01=move.Geometry, Branch02=move_2.Geometry, FlattenInputs=True)
layer_1_name = Panel("Layer 1")
layer_2_name = Panel("Layer 2")
layer_3_name = Panel("Layer 3")
entwine_2 = Entwine(Branch00=layer_1_name, Branch01=layer_2_name, Branch02=layer_3_name, FlattenInputs=True)
export_file = Button()
layer_1 = ColourSwatch(SwatchColor=RGB(208, 255, 98))
layer_2 = ColourSwatch(SwatchColor=RGB(61, 255, 231))
layer_3 = ColourSwatch(SwatchColor=RGB(180, 57, 255))
list = ValueList({"3dm", "dxf", "igs", "stl"}, selected="3dm")
preview = CustomPreview(Geometry=arrbox.Geometry, Material=layer_1)
preview_2 = CustomPreview(Geometry=move.Geometry, Material=layer_2)
preview_3 = CustomPreview(Geometry=move_2.Geometry, Material=layer_3)
entwine_3 = Entwine(Branch00=layer_1, Branch01=layer_2, Branch02=layer_3, FlattenInputs=True)
c_script = CSharpScript(
    Geometries=entwine,
    LayerNames=entwine_2,
    LayerColors=entwine_3,
    Directory="C:\Test",
    Filename="Sample",
    Extension=list,
    ExportOptions=panel,
    DiagnosticOutput=Toggle(False),
    Export=export_file)  # inputs Geometries: tree of GeometryBase, LayerNames: tree of String, LayerColors: tree of Color, Directory: String, FilePrepend: String, Filename: String, FileAppend: String, Extension: String, ExportOptions: String, RhinoCommands: String, DiagnosticOutput: Boolean, Export: Boolean
# ---------- c_script: C# usings ----------
using System.IO;
using Rhino.DocObjects;
using System.Drawing;
using System.Linq;
# ---------- c_script: C# ----------
    diagnosticOutput = DiagnosticOutput;
    counter = Export ? counter + 1 : 0;

    //if (Export && !running)
    if (counter == 1 && !running)
    {
      try
      {
        DateTime startTime = DateTime.Now;
        WriteOptionalLine("Starting the export process at " + startTime.ToString("h:mm:ss tt"));
        string directory = null;
        if (Directory == null)
        {
          string rhinodocpath = Rhino.RhinoDoc.ActiveDoc.Path;
          if (Path.GetFileNameWithoutExtension(rhinodocpath) == null)
          {
            WriteOptionalLine("Directory not specified, and no Rhino Document is loaded. Setting a default directory");
            directory = Path.Combine(Environment.GetFolderPath(Environment.SpecialFolder.MyDocuments), "GrasshopperExportedFiles");
          }
          else
          {
            WriteOptionalLine("Directory not specified, using Rhino Document Directory");
            string fullPath = Rhino.RhinoDoc.ActiveDoc.Path;
            directory = Path.GetDirectoryName(fullPath);
          }
        }
        else
        {
          WriteOptionalLine("Using Directory specified");
          directory = Directory;
        }
        if (!directory.EndsWith("\\"))
        {
          directory += "\\";
        }
        WriteOptionalLine("Export Directory: " + directory);
        if (!System.IO.Directory.Exists(directory))
        {
          RhinoApp.WriteLine("Error: The specified directory \"" + directory + "\" does not exist.");
        }
        else
        {
          string filename = null;
          if (Filename == null)
          {
            string fullPath = Rhino.RhinoDoc.ActiveDoc.Path;
            filename = Path.GetFileNameWithoutExtension(fullPath);
            if (filename == null)
            {
              WriteOptionalLine("Filename not specified, and no Rhino Document is loaded. Setting a default filename");
              filename = "Export Example";
            }
            else
            {
              WriteOptionalLine("Filename not specified, using Rhino Document Name");
            }
          }
          else
          {
            WriteOptionalLine("Using Filename specified");
            filename = Filename;
          }
          WriteOptionalLine("Export Filename:" + filename);
          string extension = null;
          if (Extension == null)
          {
            RhinoApp.WriteLine("No Extension specified, using .3dm");
            extension = ".3dm";
          }
          else
          {
            WriteOptionalLine("Using Extension specified");
            extension = Extension;
          }
          if (!extension.StartsWith("."))
          {
            extension = "." + extension;
          }
          WriteOptionalLine("Export Extension: " + extension);
          if (FilePrepend == null)
          {
            WriteOptionalLine("No FilePrepend specified, Skipping Prepend");
          }
          else
          {
            WriteOptionalLine("PrePending: " + FilePrepend + " to beginning of filename");
            filename = FilePrepend + filename;
            WriteOptionalLine("Export Filename:" + filename);
          }
          if (FileAppend == null)
          {
            WriteOptionalLine("No FileAppend  specified, Skipping Append");
          }
          else
          {
            WriteOptionalLine("Appending: " + FileAppend + " to end of filename");
            filename = filename + FileAppend;
            WriteOptionalLine("Export Filename:" + filename);
          }
          string newFilename = directory + filename + extension;
          WriteOptionalLine("Checking if " + newFilename);
          WriteOptionalLine(" = " + Rhino.RhinoDoc.ActiveDoc.Path);
          if (string.Equals(Rhino.RhinoDoc.ActiveDoc.Path, directory + filename + extension, StringComparison.OrdinalIgnoreCase))
          {
            RhinoApp.WriteLine("To prevent overwriting the Rhino file, ' - Exported' has been appended to the filename.");
            filename = filename + " - Exported";
            RhinoApp.WriteLine("Export Filename:" + newFilename);
          }
          else
          {
            WriteOptionalLine("No Conflict with the Rhino file");
          }

          Rhino.UnitSystem originalUnitSystem = Rhino.RhinoDoc.ActiveDoc.ModelUnitSystem;
          if (directory != null)
          {
            if (string.IsNullOrWhiteSpace(newFilename) ||
              !(newFilename.EndsWith(".3dm", StringComparison.OrdinalIgnoreCase) ||
              newFilename.EndsWith(".dxf", StringComparison.OrdinalIgnoreCase) ||
              newFilename.EndsWith(".dgn", StringComparison.OrdinalIgnoreCase) ||
              newFilename.EndsWith(".stl", StringComparison.OrdinalIgnoreCase) ||
              newFilename.EndsWith(".step", StringComparison.OrdinalIgnoreCase) ||
              newFilename.EndsWith(".igs", StringComparison.OrdinalIgnoreCase) ||
              newFilename.EndsWith(".iges", StringComparison.OrdinalIgnoreCase)))
            {
              RhinoApp.WriteLine("Error: The specified filename: \"" + newFilename + "\" is invalid or does not have a supported extension.");

            }
            else
            {
              if (Geometries == null || Geometries.BranchCount == 0)
              {
                RhinoApp.WriteLine("Error: No geometry data provided.");

              }
              else
              {
                if (Geometries.BranchCount != LayerNames.BranchCount || Geometries.BranchCount != LayerColors.BranchCount)
                {
                  RhinoApp.WriteLine("Error: The number of branches in Geometries (" + Geometries.BranchCount +
                    "), LayerNames (" + LayerNames.BranchCount + "), and LayerColors (" +
                    LayerColors.BranchCount + ") must be the same.");

                }
                else
                {
                  // Create lists to hold the guids for each layer and for temporary objects
                  var guidsByLayer = new List<List<Guid>>();
                  var tempObjectGuids = new List<Guid>();

                  // Create and add layers based on the data tree of layer names and colors
                  var layerIndices = new List<int>();
                  for (int i = 0; i < LayerNames.BranchCount; i++)
                  {
                    var layerName = LayerNames.Branches[i][0];
                    var layerColor = LayerColors.Branches[i][0];

                    var layerIndex = Rhino.RhinoDoc.ActiveDoc.Layers.Add(layerName, layerColor);
                    layerIndices.Add(layerIndex);

                    guidsByLayer.Add(new List<Guid>());
                  }

                  // Loop through the data tree of geometries and add objects to layers
                  for (int i = 0; i < Geometries.BranchCount; i++)
                  {
                    var branch = Geometries.Branches[i];
                    var layerIndex = layerIndices[i];
                    var layerName = LayerNames.Branches[i][0];

                    foreach (var geometry in branch)
                    {
                      if (geometry != null)
                      {
                        var guid = Rhino.RhinoDoc.ActiveDoc.Objects.Add(geometry);
                        guidsByLayer[i].Add(guid);
                        tempObjectGuids.Add(guid);

                        // Modify the attributes of the added object to specify the desired layer index
                        var objAttributes = Rhino.RhinoDoc.ActiveDoc.Objects.FindId(guid).Attributes;
                        objAttributes.LayerIndex = layerIndex;
                        Rhino.RhinoDoc.ActiveDoc.Objects.ModifyAttributes(guid, objAttributes, false);
                      }
                    }
                  }

                  // Select all objects created in the script
                  List<Guid> allGuids = new List<Guid>();
                  foreach (var guids in guidsByLayer)
                  {
                    allGuids.AddRange(guids);
                  }
                  Rhino.RhinoDoc.ActiveDoc.Objects.Select(allGuids);

                  // Dictionary to store GUIDs for each step
                  Dictionary<string, List<Guid>> stepGuids = new Dictionary<string, List<Guid>>();

                  string defaultRhinoCommands = "";
                  string rhinoCommandsInput = RhinoCommands as string;
                  string[] commandList = (string.IsNullOrEmpty(rhinoCommandsInput) ? defaultRhinoCommands : rhinoCommandsInput).Split(new[] { '\n', ';' }, StringSplitOptions.RemoveEmptyEntries);
                  // Check if there are any additional commands
                  if (commandList.Length > 0)
                  {
                    RhinoApp.WriteLine("Running additional Rhino Commands...");
                    foreach (string command in commandList)
                    {
                      RhinoApp.WriteLine(command);


                      bool requiresCurves =
                        command.ToLower().Contains("convert") ||
                        command.ToLower().Contains("chamfercrv") ||
                        command.ToLower().Contains("extendcrv") ||
                        command.ToLower().Contains("trim") ||
                        command.ToLower().Contains("split") ||
                        command.ToLower().Contains("join") ||
                        command.ToLower().Contains("curveboolean") ||
                        command.ToLower().Contains("curvethroughpt") ||
                        command.ToLower().Contains("offsetcrv") ||
                        command.ToLower().Contains("curveeditptson") ||
                        command.ToLower().Contains("match") ||
                        command.ToLower().Contains("rebuild") ||
                        command.ToLower().Contains("simplifycrv") ||
                        command.ToLower().Contains("offset") ||
                        command.ToLower().Contains("deviation");


                      // Check if there are any curves before executing the steps
                      var selectedObjects = Rhino.RhinoDoc.ActiveDoc.Objects.GetSelectedObjects(false, false);

                      var hasCurves = selectedObjects != null && selectedObjects.Any(obj => obj.ObjectType == Rhino.DocObjects.ObjectType.Curve);

                      if (requiresCurves && !hasCurves)
                      {
                        RhinoApp.WriteLine("Skipping command: " + command + " (requires curves, but no curves are available)");

                        continue;
                      }
                      if (command.StartsWith("proauto", StringComparison.OrdinalIgnoreCase)) //run Special ProAuto commands that are diffiuclt any other way
                      {
                        var ProAutoCommand = command.Substring(command.IndexOf("(") + 1, command.IndexOf(")") - command.IndexOf("(") - 1).Trim();
                        RhinoApp.WriteLine("Running Proauto command: " + ProAutoCommand);

                        if (ProAutoCommand.Equals("Millimeterfix", StringComparison.OrdinalIgnoreCase))
                        {
                          Rhino.RhinoDoc.ActiveDoc.ModelUnitSystem = Rhino.UnitSystem.Millimeters;
                        }
                      }
                      else
                      {
                        Rhino.RhinoApp.RunScript(command, true);
                      }

                      // Get the selected objects and store their GUIDs in the dictionary
                      selectedObjects = Rhino.RhinoDoc.ActiveDoc.Objects.GetSelectedObjects(true, false);
                      stepGuids[command] = selectedObjects.Select(obj => obj.Id).ToList();
                      Rhino.RhinoDoc.ActiveDoc.ModelUnitSystem = originalUnitSystem;
                    }
                  }


                  // Run export script
                  RhinoApp.WriteLine("Exporting to " + newFilename);
                  string exportOptions = ExportOptions ?? "";
                  if (File.Exists(newFilename))
                  {
                    File.Delete(newFilename);
                  }
                  Rhino.RhinoApp.RunScript("_-Export " + exportOptions + " \"" + newFilename + "\"" + " _Enter", diagnosticOutput);

                  foreach (var kvp in stepGuids)
                  {
                    Rhino.RhinoDoc.ActiveDoc.Objects.Delete(kvp.Value, false);
                  }

                  // Delete all the objects added to layers during the script
                  Rhino.RhinoDoc.ActiveDoc.Objects.Delete(allGuids, false);
                  Rhino.RhinoDoc.ActiveDoc.Objects.Delete(tempObjectGuids, false);

                  // Delete the temporary layers
                  foreach (var layerIndex in layerIndices)
                  {
                    Rhino.RhinoDoc.ActiveDoc.Layers.Delete(layerIndex, false);
                  }
                }
              }
            }
          }
        }
        DateTime finishTime = DateTime.Now;
        TimeSpan runtime = finishTime - startTime;
        RhinoApp.WriteLine("Export completed at " + finishTime.ToString("h:mm:ss tt") + ". Total runtime: " + runtime.TotalSeconds + " seconds.");
      }
      catch (Exception ex)
      {
        RhinoApp.WriteLine("An error occurred: " + ex.Message);
      }
      finally
      {
        running = false;
      }
    }
# ---------- c_script: C# additional code ----------
  void WriteOptionalLine(string message)
  {
    if (diagnosticOutput)
    {
      RhinoApp.WriteLine(message);
    }
  }
  int counter;
  bool running = false;
  bool diagnosticOutput;
# ---------- end c_script ----------
